# Grasshopper definition 08_ShadowStudy.gh (Grasshopper 1.0.7)

# ----
# weather/location input
panel = Panel("https://energyplus.net/weather-download/north_and_central_america_wmo_region_4/USA/MO/USA_MO_Kansas.City.724460_TMY2/all")
downloadepw = LBDownloadWeather(weather_URL=panel)  # -> epw_file, stat_file, ddy_file; plug-in component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
importloc = LBImportLocation(epw_file=downloadepw.epw_file)  # -> location; plug-in component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
hoy = LBCalculateHOY(month=Slider(6, range=0..12), day=Slider(24, range=0..31), hour=Slider(9, range=0..24), minute=Slider(30, range=0..60))  # -> flatten(hoy), flatten(doy), flatten(date); plug-in component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

crv = Curve(<curve referenced from the Rhino model>)
ladybug = Ladybug_Ladybug()  # -> Vviiiiiiiiiizzz; plug-in component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
data = Data(crv)
join = JoinCurves(Curves=data, Preserve=False)
sunpath = LBSunPath(location=importloc, hoys=hoy.hoy, scale=Slider(0.5, range=0..1))  # -> report, vectors, altitudes, azimuths, hoys, sun_pts, analemma, daily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; plug-in component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
boundary = BoundarySurfaces(Edges=data)
brep = Brep(boundary)
dam = DataDam(DataA=sunpath.vectors, BufferDelay=10000000, BufferMode=0)
ground = Brep(<brep referenced from the Rhino model>)
shadowstudy = Ladybug_ShadowStudy(geometry=[ground, brep], sunVector=dam)  # -> readMe, shadow, shade; plug-in component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
boundary_2 = BoundarySurfaces(Edges=shadowstudy.shadow)
join_2 = BrepJoin(Breps=boundary_2)  # -> Breps, Closed
fmerge = MergeFaces(Brep=join_2.Breps)  # -> Breps, Before, After
data_2 = Data(data)
edges = BrepEdges(Brep=fmerge.Breps)  # -> Naked, Interior, NonManifold
flip = FlipCurve(Curve=data_2)  # -> Curve, Flag
crv_2 = Curve(<curve referenced from the Rhino model>)
explode = Explode(Curve=data_2, Recursive=True)  # -> Segments, Vertices
join_3 = JoinCurves(Curves=edges.Naked, Preserve=False)
flip_2 = FlipCurve(Curve=explode.Segments)  # -> Curve, Flag

# ----
# fixes twisty loft
shift = ShiftList(List=flip_2.Curve, Shift=Slider(7, range=0..10), Wrap=True)

offset = OffsetCurve(Curve=join_3, Distance=Slider(143, range=-24..150), Plane=PlaneXY(0, 0, 0), Corners=Slider(1, range=0..10))
# How to loft without manually plugging them in?
rev = ReverseList(List=flip_2.Curve)
explode_2 = Explode(Curve=offset, Recursive=True)  # -> Segments, Vertices
shift_2 = ShiftList(List=explode_2.Segments, Shift=Slider(5, range=0..10), Wrap=True)
item = ListItem(List=shift, Index=0, Wrap=True)  # -> Item, Item1, Item2, Item3, Item4, Item5, Item6, Item7
item_2 = ListItem(List=shift_2, Index=0, Wrap=True)  # -> Item, Item1, Item2, Item3, Item4, Item5, Item6, Item7
item_3 = ListItem(List=shift, Index=0, Wrap=True)  # -> Item, Item1, Item2, Item3, Item4, Item5, Item6, Item7
item_4 = ListItem(List=edges.Naked, Index=0, Wrap=True)  # -> Item, Item1, Item2, Item3, Item4, Item5, Item6, Item7
loft = Loft(
    Curves=flatten([item.Item, item_2.Item]),
    Options={Adjust=False, Closed=False, LoftEnds=0, LoftSimp=0, LoftType=0, Rebuild=10, Refit=0.01})
loft_2 = Loft(
    Curves=flatten([item_2.Item3, item.Item1]),
    Options={Adjust=False, Closed=False, LoftEnds=0, LoftSimp=0, LoftType=0, Rebuild=10, Refit=0.01})
loft_3 = Loft(
    Curves=flatten([item_2.Item2, item.Item2]),
    Options={Adjust=False, Closed=False, LoftEnds=0, LoftSimp=0, LoftType=0, Rebuild=10, Refit=0.01})
loft_4 = Loft(
    Curves=flatten([item_2.Item1, item.Item3]),
    Options={Adjust=False, Closed=False, LoftEnds=0, LoftSimp=0, LoftType=0, Rebuild=10, Refit=0.01})
loft_5 = Loft(
    Curves=flatten([item.Item4, item_2.Item4]),
    Options={Adjust=False, Closed=False, LoftEnds=0, LoftSimp=0, LoftType=0, Rebuild=10, Refit=0.01})  # disabled
loft_6 = Loft(
    Curves=flatten([item.Item5, item_2.Item5]),
    Options={Adjust=False, Closed=False, LoftEnds=0, LoftSimp=0, LoftType=0, Rebuild=10, Refit=0.01})  # disabled
loft_7 = Loft(
    Curves=flatten([item_3.Item, item_4.Item]),
    Options={Adjust=False, Closed=False, LoftEnds=0, LoftSimp=0, LoftType=0, Rebuild=10, Refit=0.01})
loft_8 = Loft(
    Curves=flatten([item_4.Item3, item_3.Item1]),
    Options={Adjust=False, Closed=False, LoftEnds=0, LoftSimp=0, LoftType=0, Rebuild=10, Refit=0.01})
loft_9 = Loft(
    Curves=flatten([item_4.Item2, item_3.Item2]),
    Options={Adjust=False, Closed=False, LoftEnds=0, LoftSimp=0, LoftType=0, Rebuild=10, Refit=0.01})
loft_10 = Loft(
    Curves=flatten([item_4.Item1, item_3.Item3]),
    Options={Adjust=False, Closed=False, LoftEnds=0, LoftSimp=0, LoftType=0, Rebuild=10, Refit=0.01})
loft_11 = Loft(
    Curves=flatten([item_3.Item4, item_4.Item4]),
    Options={Adjust=False, Closed=False, LoftEnds=0, LoftSimp=0, LoftType=0, Rebuild=10, Refit=0.01})  # disabled
loft_12 = Loft(
    Curves=flatten([item_3.Item5, item_4.Item5]),
    Options={Adjust=False, Closed=False, LoftEnds=0, LoftSimp=0, LoftType=0, Rebuild=10, Refit=0.01})  # disabled
merge = Merge(Data1=loft, Data2=loft_2, Data3=loft_3, Data4=loft_4, Data5=loft_5, Data6=loft_6)
merge_2 = Merge(Data1=loft_7, Data2=loft_8, Data3=loft_9, Data4=loft_10, Data5=loft_11, Data6=loft_12)
join_4 = BrepJoin(Breps=merge)  # -> Breps, Closed
join_5 = BrepJoin(Breps=merge_2)  # -> Breps, Closed
merge_3 = Merge(Data1=join_5.Breps, Data2=join_4.Breps)
