# Grasshopper definition PYTHON examples.gh (Grasshopper 1.0.7)
# plug-ins: Kangaroo2 Components, NGon, Heteroptera, Pufferfish

number_slider = Slider(8, range=0..10)
python = GhPythonScript(num1=number_slider, num2=number_slider)  # -> out, pts1_out, pts2_out, pts3_out; inputs num1: Int32
# ---------- python: Python ----------
__author__ = "zacje"
__version__ = "2022.02.27"

import rhinoscriptsyntax as rs
import ghpythonlib.components as gh
import Rhino.Geometry as rg

pts1 = []
pts2 = []
pts3 = []

for x in range(0,100,1):
    for y in range(0,100,1):
        pt = rs.AddPoint(x,y,0)
        if x % num1 == 0 and y % num2 == 0:
            pts1.append(pt)
        elif x % num1 == 0 or y % num2 == 0:
            pts2.append(pt)
        else:
            pts3.append(pt)

pts1_out = pts1
pts2_out = pts2
pts3_out = pts3
# ---------- end python ----------
# If -elif - else Conditional
preview = CustomPreview(Geometry=python.pts1_out, Material=ColourSwatch(SwatchColor=RGB(179, 201, 68)))
preview_2 = CustomPreview(Geometry=python.pts2_out, Material=ColourSwatch(SwatchColor=RGB(219, 70, 70)))
preview_3 = CustomPreview(Geometry=python.pts3_out, Material=ColourSwatch(SwatchColor=RGB(255, 255, 255)))

# ----
# Python Examples
number_slider_2 = Slider(3, range=0..10)
# Import functions into python to use in your scripts
# rhinoscriptsyntax = rhino commands
# 
# ghpythonlib.components = all components in
# your grasshopper window, including plugins
# Point
python_2 = GhPythonScript()  # -> out, pt1_out, pt2_out
# ---------- python_2: Python ----------
__author__ = "zacje"
__version__ = "2022.02.27"

import rhinoscriptsyntax as rs
import ghpythonlib.components as gh
import Rhino.Geometry as rg

pt1 = rg.Point3d(10,0,0)
pt2 = rs.AddPoint(0,5,0)

pt1_out = pt1
pt2_out = pt2
# ---------- end python_2 ----------
# Number Slider Input
python_3 = GhPythonScript(x=number_slider_2, y=Slider(4, range=0..10))  # -> out, pt1_out, pt2_out
# ---------- python_3: Python ----------
__author__ = "zacje"
__version__ = "2022.02.27"

import rhinoscriptsyntax as rs
import ghpythonlib.components as gh
import Rhino.Geometry as rg

pt1 = rg.Point3d(10,x,0)
pt2 = rs.AddPoint(y,5,0)

pt1_out = pt1
pt2_out = pt2
# ---------- end python_3 ----------
# Array of Points using For Loop
# loops through each item in a list, and for each
# item, executes the code you write under the
# function. Needs to be indented.
python_4 = GhPythonScript(x=Slider(8, range=0..10))  # -> out, pts_out; inputs x: Int32
# ---------- python_4: Python ----------
__author__ = "zacje"
__version__ = "2022.02.27"

import rhinoscriptsyntax as rs
import ghpythonlib.components as gh
import Rhino.Geometry as rg

pts = []

for i in range(x):
    pt = rs.AddPoint(i,0,0)
    pts.append(pt)

pts_out = pts
# ---------- end python_4 ----------
# If - Else Conditional
python_5 = GhPythonScript(x=Slider(7, range=0..10), y=Slider(3, range=0..10))  # -> out, pts_out; inputs x: Int32
# ---------- python_5: Python ----------
__author__ = "zacje"
__version__ = "2022.02.27"

import rhinoscriptsyntax as rs
import ghpythonlib.components as gh
import Rhino.Geometry as rg

pts = []
for i in range(x):
    if i < y:
        pt = rs.AddPoint(i,0,0)
        pts.append(pt)
    else:
        pt = rs.AddPoint(i,10,0)
        pts.append(pt)

pts_out = pts
# ---------- end python_5 ----------
# 2D array of Points
# Stacking two for loops, so for each loop of the x
#  - coordinate, it is looping through the Y
#  coordinate. Simple because range function
#  creates a list of integers for it to loop through
#  and use as coordinates
python_6 = GhPythonScript(n=Slider(2, range=0..10))  # -> out, pts_out; inputs n: Int32
# ---------- python_6: Python ----------
__author__ = "zacje"
__version__ = "2022.02.27"

import rhinoscriptsyntax as rs
import ghpythonlib.components as gh
import Rhino.Geometry as rg

pts = []
for i in range(n):
    for j in range(n):
        pt = rs.AddPoint(i,j,0)
        pts.append(pt)

pts_out = pts
# ---------- end python_6 ----------

# ----
# Intro to Python in Grasshopper
# This document is best for those with prior experience in grasshopper.
# Anatomy of the Node
# Inputs/Parameters
# function
# Outputs
# -right click on the node,
# -choose "select brep",
# -select your geometry
# in the rhino window
# Right click and select "bake" to take geometry
# out of grasshopper's ghosted form and into rhino
# -All inputs must be set to
# appropriate geometry types
# and plugged in for this to work.
# -Results will appear in the rhino window
# as "ghosted" forms.
number_slider_3 = Slider(0.5, range=0..1)
brep = Brep()
pt = Point()
scale = Scale(Geometry=brep, Center=pt, Factor=number_slider_3)  # -> Geometry, Transform
# "out" cannot be replaced with custom outputs.
# Instead, add more outputs with the + symbol
# which becomes visible when you zoom in very
# close to the node.
geo = Geometry(scale.Geometry)

brep_2 = Brep()
pt_2 = Point()
# A Ghpython node follows the same
# logic, but now you can define your
# own variables and outputs.
# 
# So that the function knows what kind of
# geometry you are inputing, you usually
# will have to change the "type hint" by
# right clicking on the input name.
python_7 = GhPythonScript(X=brep_2, Y=pt_2)  # -> Out, A

# ----
# 3D array of points
# Using Math Library
# Strategies to create lines & curves
# Test whether points are in curve
number_slider_4 = Slider(10, range=0..10)
crv = Curve(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)
pt_3 = Point(Point(-3.534247963, 18.39074023, 0))
pt_4 = Point([Point(0.009983341665, 0.09950041653, 0.1), Point(0.03973386616, 0.1960133156, 0.2), Point(0.088656062, 0.2866009467, 0.3), Point(0.1557673369, 0.3684243976, 0.4), Point(0.2397127693, 0.4387912809, 0.5), Point(0.338785484, 0.4952013689, 0.6)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])
pt_5 = Point(Point(12.02084592, 7.742525027, 0))
python_8 = GhPythonScript(step=number_slider_4)  # -> out, pts, R_out, G_out, B_out; inputs step: Int32
# ---------- python_8: Python ----------
import rhinoscriptsyntax as rs
import random as r

pts = []
R = []
G = []
B = []

for x in range(0,256,step):
    for y in range(0,256,step):
        for z in range(0,256,step):
            pt = rs.AddPoint(x,y,z)
            pts.append(pt)
            R.append(x)
            G.append(y)
            B.append(z)
pts_out = pts
R_out = R
G_out = G
B_out = B
# ---------- end python_8 ----------
python_9 = GhPythonScript()  # -> out, pts_out
# ---------- python_9: Python ----------
import math as m
import rhinoscriptsyntax as rs

pts = []

for i in rs.frange(0.0,100.0,0.1):
    x = i*m.sin(i)
    y = i*m.cos(i)
    z = i

    pt = rs.AddPoint(x,y,z)
    pts.append(pt)

pts_out = pts
# ---------- end python_9 ----------
python_10 = GhPythonScript(pt1=pt_3, pt2=pt_5, pts=flatten(pt_4))  # -> out, curveA_out, curveB_out, curveC_out; inputs pt1: Point3d, pt2: Point3d, pts: list of Point3d
# ---------- python_10: Python ----------
import rhinoscriptsyntax as rs

line = rs.AddLine(pt1,pt2)
line_out = line

curveA = rs.AddPolyline(pts)
curveB = rs.AddCurve(pts)
curveC = rs.AddInterpCurve(pts)

curveA_out = curveA
curveB_out = curveB
curveC_out = curveC
# ---------- end python_10 ----------
python_11 = GhPythonScript(Curve=crv)  # -> out, ptIn_out, ptOut_out
# ---------- python_11: Python ----------
import random as r
import rhinoscriptsyntax as rs

pts = []

for i in range(100):
    pt = rs.AddPoint(r.uniform(0,10),r.uniform(0,10),0)
    pts.append(pt)

boolean = []
ptIn = []
ptOut = []

for i in range(len(pts)):
    pt_in_or_not = rs.PointInPlanarClosedCurve(pts[i],Curve)
    print(pt_in_or_not)
    if pt_in_or_not == True:
        ptIn.append(pts[i])
    if pt_in_or_not == False:
        ptOut.append(pts[i])

ptIn_out = ptIn
ptOut_out = ptOut
# ---------- end python_11 ----------
rgb = ColourRGB(Alpha=255, Red=python_8.R_out, Green=python_8.G_out, Blue=python_8.B_out)
pt_6 = Point(python_11.ptIn_out)
pt_7 = Point(python_11.ptOut_out)
preview_4 = CustomPreview(Geometry=python_8.pts, Material=rgb)
preview_5 = CustomPreview(Geometry=python_10.curveA_out, Material=ColourSwatch(SwatchColor=RGB(252, 129, 129)))
preview_6 = CustomPreview(Geometry=python_10.curveB_out, Material=ColourSwatch(SwatchColor=RGB(184, 252, 205)))
preview_7 = CustomPreview(Geometry=python_10.curveC_out, Material=ColourSwatch(SwatchColor=RGB(167, 81, 252)))

# ----
# Random number generation
# functions imported from rhinoscriptsyntax take
# the same inputs that they do in the rhino
# window.
# Random 2D Point
# curve from random points, 3D
number_slider_5 = Slider(6, range=0..10)
python_12 = GhPythonScript()  # -> out, curve_out
# ---------- python_12: Python ----------
import rhinoscriptsyntax as rs
import random

pts = []

for i in range(0,100):
    x = random.uniform(0,100)
    y = random.uniform(0,100)
    z = random.uniform(0,100)
    pt = rs.AddPoint(x,y,z)
    pts.append(pt)


curve = rs.AddCurve(pts)
curve_out = curve
# ---------- end python_12 ----------
python_13 = GhPythonScript()  # -> out, ran1_out, ran2_out, ran3_out
# ---------- python_13: Python ----------
import rhinoscriptsyntax as rs
import random

ran1 = random.random()
ran2 = random.randint(0,100)
ran3 = random.uniform(0,100)

random.uniform
ran1_out = ran1
ran2_out = ran2
ran3_out = ran3
# ---------- end python_13 ----------
python_14 = GhPythonScript(n=number_slider_5)  # -> out, pts_out, ran2_out, ran3_out; inputs n: Int32
# ---------- python_14: Python ----------
import rhinoscriptsyntax as rs
import random as r

pts = []

for i in range(n):
    pt = rs.AddPoint(r.uniform(0,10),r.uniform(0,10),0)
    pts.append(pt)

pts_out = pts
# ---------- end python_14 ----------
crv_2 = Curve(python_12.curve_out)
panel = Panel(python_13.ran3_out)

# ----
# 1
geo_2 = Geometry(python_7.A)

# ----
# Create Vector, analyze and modify
# 3
# Vector operations
# Move an object by Vector
# Move an object by random Vector
python_15 = GhPythonScript()  # -> out, pts_out
# ---------- python_15: Python ----------
import rhinoscriptsyntax as rs

pts = []
pt = rs.AddPoint(0,0,0)
pts.append(pt)

vec = (1,0,0)

for i in range(10):
    newPt = rs.CopyObject(pts[-1],vec)
    pts.append(newPt)

pts_out = pts
# ---------- end python_15 ----------
python_16 = GhPythonScript()  # -> out, pts_out
# ---------- python_16: Python ----------
import rhinoscriptsyntax as rs

pts = []
pt = rs.AddPoint(0,0,0)
pts.append(pt)

vec1 = (2,0,0)
vec2 = (0,2,0)

for i in range(10):
    newPt = rs.CopyObject(pts[-1],vec1)
    pts.append(newPt)
    newPt = rs.CopyObject(pts[-1],vec2)
    pts.append(newPt)

polyline = rs.AddPolyline(pts)

pts_out = pts
polyline_out = polyline
# ---------- end python_16 ----------
python_17 = GhPythonScript()  # -> out, pts_out, polyline_out
# ---------- python_17: Python ----------
import rhinoscriptsyntax as rs
import random

pts = []
pt = rs.AddPoint(0,0,0)
pts.append(pt)

for i in range(100):
    xDir = random.uniform(-3.0,10.0)
    yDir = random.uniform(-3.0,10.0)
    zDir = random.uniform(-3.0,10.0)
    vec = (xDir,yDir,zDir)
    newPt = rs.CopyObject(pts[-1],vec)
    pts.append(newPt)

polyline = rs.AddPolyline(pts)

pts_out = pts
polyline_out = polyline
# ---------- end python_17 ----------
# 2
python_18 = GhPythonScript()  # -> out, vecLength_out, unitVec_out, vecScale_out, vecReverse_out, vecRotate_out
# ---------- python_18: Python ----------
import rhinoscriptsyntax as rs

vector = (3,4,0)

vecLength_out = rs.VectorLength(vector)
unitVec_out = rs.VectorUnitize(vector)
vecScale_out = rs.VectorScale(vector,5)
vecReverse_out = rs.VectorReverse(vector)
vecRotate_out = rs.VectorRotate(vector,90,[0,0,1])
# ---------- end python_18 ----------
python_19 = GhPythonScript()  # -> out, vecAdd_out, vecSub_out, vecCrossProduct_out, vecAngle_out
# ---------- python_19: Python ----------
import rhinoscriptsyntax as rs

vectorA = (4,0,0)
vectorB = (2,5,0)

vecAdd_out = rs.VectorAdd(vectorA,vectorB)
vecSub_out = rs.VectorSubtract(vectorB,vectorA)
vecCrossProduct_out = rs.VectorCrossProduct(vectorA,vectorB)
vecAngle_out = rs.VectorAngle(vectorA,vectorB)
# ---------- end python_19 ----------
panel_2 = Panel(python_18.vecLength_out)
panel_3 = Panel(python_18.vecReverse_out)
panel_4 = Panel(python_18.vecRotate_out)
panel_5 = Panel(python_19.vecAdd_out)
panel_6 = Panel(python_19.vecSub_out)
panel_7 = Panel(python_19.vecCrossProduct_out)
panel_8 = Panel(python_19.vecAngle_out)
panel_9 = Panel(python_18.unitVec_out)
panel_10 = Panel(python_18.vecScale_out)

# ----
# Generate Brick Wall along Curve
# 4
number_slider_6 = Slider(9, range=0..150)
crv_3 = Curve(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)
python_20 = GhPythonScript(
    curve=crv_3,
    divideNum=number_slider_6,
    width=Slider(4.4, range=0..10),
    length=Slider(8.1, range=0..10),
    height=Slider(4.7, range=0..10),
    layer=Slider(4, range=0..10))  # -> out, brickWall_out, brickList_out; inputs curve: Curve, divideNum: Int32, layer: Int32
# ---------- python_20: Python ----------
import rhinoscriptsyntax as rs

bricklist = []

domain = rs.CurveDomain(curve)
stp = domain[0]
edp = domain[1]
step = (edp-stp)/divideNum

for t in rs.frange(stp,edp,step):
# frange is float version of the range function. Inputs are same,
# (start, step (optional), end) 
    pt = rs.EvaluateCurve(curve,t) 
    tan = rs.CurveTangent(curve,t)
    normal = rs.CurveNormal(curve,t)
    vecCP = rs.VectorCrossProduct(tan,normal)

    tanPt = rs.CopyObject(pt,tan)
    vecCPPt = rs.CopyObject(pt,vecCP)
    plane = rs.PlaneFromPoints(pt,tanPt,vecCPPt)
    rect = rs.AddRectangle(plane,length,width)
    rect = rs.MoveObject(rect,-(tan*length/2+vecCP*width/2))

    vector = height*normal
    pt2 = rs.CopyObject(pt,vector)
    line = rs.AddLine(pt, pt2)
    brick = rs.ExtrudeCurve(rect,line)
    rs.CapPlanarHoles(brick)
    bricklist.append(brick)

bricklist_out = bricklist

brickwall = []
for i in range(len(bricklist)):
    if i % 2 == 0:
        for j in range(layer):
            brick = rs.CopyObject(bricklist[i],[0,0,height*2*j])
            brickwall.append(brick)
        else:
            rs.MoveObject(bricklist[i],[0,0,height])
            for j in range(layer):
                brick = rs.CopyObject(bricklist[i],[0,0,height])
                brickwall.append(brick)
brickWall_out = brickwall
# ---------- end python_20 ----------
geo_3 = Geometry(python_20.brickList_out)

number_slider_7 = Slider(2, range=0..10)
srf = Surface(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)
crv_4 = Curve(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)
python_21 = GhPythonScript(surface=srf)  # -> out, centerPoint_out, normalVectorLine_out
# ---------- python_21: Python ----------
#evaluate surface and normal
import rhinoscriptsyntax as rs

domainU = rs.SurfaceDomain(surface,0)
domainV = rs.SurfaceDomain(surface,1)

u = (domainU[1] - domainU[0])/2
v = (domainV[1] - domainV[0])/2

centerPoint = rs.EvaluateSurface(surface,u,v)
centerPoint_out = centerPoint

normal = rs.SurfaceNormal(surface,[u,v])
startPt = centerPoint
endPt = rs.CopyObject(startPt,normal)
normalVectorLine = rs.AddLine(startPt,endPt)

normalVectorLine_out = normalVectorLine
# ---------- end python_21 ----------
python_22 = GhPythonScript(curve=crv_4, divideNum=Slider(7, range=0..10), width=number_slider_7, length=number_slider_7, height=number_slider_7)  # -> out, brickList_out
# ---------- python_22: Python ----------
import rhinoscriptsyntax as rs
#define bricklist as a list
bricklist = []
#define domain as curve domain, starting point and end points
domain = rs.CurveDomain(curve)
stp = domain[0]
edp = domain[1]
step = (edp-stp)/divideNum

for t in rs.frange(stp,edp,step):
    #frange = a range but with floats. This loop is going to be generating
    #a series of points dividing the curve. Looping through t, or tangent.
    pt = rs.EvaluateCurve(curve,t)
    tan = rs.CurveTangent(curve,t)
    normal = rs.CurveNormal(curve,t)
    vecCP = rs.VectorCrossProduct(tan,normal)

    tanPt = rs.CopyObject(pt,tan)
    vecCPPt = rs.CopyObject(pt,vecCP)
    plane = rs.PlaneFromPoints(pt,tanPt,vecCPPt)
    rect = rs.AddRectangle(plane,length,width)
    rect = rs.MoveObject(rect,-(tan*length/2+vecCP*width/2))

    vector = height*normal
    pt2 = rs.CopyObject(pt,vector)
    line = rs.AddLine(pt,pt2)
    brick = rs.ExtrudeCurve(rect,line)
    rs.CapPlanarHoles(brick)
    bricklist.append(brick)

brickList_out = bricklist
# ---------- end python_22 ----------
python_23 = GhPythonScript(surface=srf)  # -> out, domainU_out, domainV_out
# ---------- python_23: Python ----------
#surface domain
import rhinoscriptsyntax as rs

domainU = rs.SurfaceDomain(surface,0)
domainV = rs.SurfaceDomain(surface,1)

domainU_out = domainU
domainV_out = domainV
# ---------- end python_23 ----------
panel_11 = Panel(python_23.domainV_out)
panel_12 = Panel(python_23.domainU_out)
python_24 = GhPythonScript(angle=Slider(45, range=0..100), degree=Slider(4, range=0..10))  # -> out, branch_out
# ---------- python_24: Python ----------
#Recursive branching
import rhinoscriptsyntax as rs

startline = rs.AddLine((0,0,0),(0,1,0))

def branch(line,result,degree):
    ptS = rs.CurveStartPoint(line)
    ptE = rs.CurveEndPoint(line)
    
    dir1 = rs.VectorCreate(ptE,ptS)
    dir1 = rs.VectorRotate(dir1,angle,[0,0,1])
    dir1 = rs.VectorScale(dir1,0.8)
    newPt1 = rs.CopyObject(ptE,dir1)
    newLine1 = rs.AddLine(ptE,newPt1)

    dir2 = rs.VectorCreate(ptE,ptS)
    dir2 = rs.VectorRotate(dir2,-angle,[0,0,1])
    dir2 = rs.VectorScale(dir2,0.8)
    newPt2 = rs.CopyObject(ptE,dir2)
    newLine2 = rs.AddLine(ptE,newPt2)

    result.append(newLine1)
    result.append(newLine2)

    if(degree>0):
        branch(newLine1,result,degree-1)
        branch(newLine2,result,degree-1)

    return result

tree = []
tree.append(startline)

branch_out = branch(startline,tree,degree)
# ---------- end python_24 ----------
python_25 = GhPythonScript(angle=Slider(41, range=0..100))  # -> out, branch_out
# ---------- python_25: Python ----------
#Recursive branching
import rhinoscriptsyntax as rs

startline = rs.AddLine((0,0,0),(0,1,0))

def branch(startline,result):
    ptS = rs.CurveStartPoint(startline)
    ptE = rs.CurveEndPoint(startline)
    
    dir1 = rs.VectorCreate(ptE,ptS)
    dir1 = rs.VectorRotate(dir1,angle,[0,0,1])
    dir1 = rs.VectorScale(dir1,0.8)
    newPt1 = rs.CopyObject(ptE,dir1)
    newLine1 = rs.AddLine(ptE,newPt1)

    dir2 = rs.VectorCreate(ptE,ptS)
    dir2 = rs.VectorRotate(dir2,-angle,[0,0,1])
    dir2 = rs.VectorScale(dir2,0.8)
    newPt2 = rs.CopyObject(ptE,dir2)
    newLine2 = rs.AddLine(ptE,newPt2)

    result.append(newLine1)
    result.append(newLine2)

    return result

tree = []
tree.append(startline)

branch_out = branch(startline,tree)
# ---------- end python_25 ----------
geo_4 = Geometry(python_25.branch_out)
geo_5 = Geometry(python_24.branch_out)
crv_5 = Curve([<curve referenced from the Rhino model> x4])
geo_6 = Geometry(<brep referenced from the Rhino model>)
project = Project(Curve=crv_5, Brep=geo_6, Direction=Vector(0, 0, 1))
srfsplit = SurfaceSplit(Surface=geo_6, Curves=project)
item = ListItem(List=srfsplit, Index=0, Wrap=True)  # -> Item, Item1, Item2, Item3
srf_2 = Surface(item.Item3)
# Bubble From Base Curve
crv_6 = Curve(project)
explode = Explode(Curve=crv_6, Recursive=True)  # -> Segments, Vertices
crv_7 = Curve([<curve referenced from the Rhino model> x17])
panel_13 = Panel(explode.Segments)
item_2 = ListItem(List=explode.Segments, Index=0, Wrap=True)
loft = Loft(Curves=graft(crv_7), Options={Adjust=False, Closed=False, LoftEnds=0, LoftSimp=0, LoftType=0, Rebuild=10, Refit=0.01})
md_slider = MDSlider(SliderMode=0, slider_value=Point(0, 1, 0.5), x_domain=Domain(0, 1), y_domain=Domain(0, 1), z_domain=Domain(0, 1))
boundary = BoundarySurfaces(Edges=crv_5)
center = Center(Geometric=boundary)  # -> Center, Dimension
crv_8 = Curve(<curve referenced from the Rhino model>)
crv_9 = Curve(<curve referenced from the Rhino model>)
splop = Splop(Geometry=boundary, Plane=center.Center, Surface=geo_6, Parameter=md_slider, Angle=0, Rigid=False)
flip = FlipCurve(Curve=crv_8)  # -> Curve, Flag
crv_10 = Curve(<curve referenced from the Rhino model>)
mesh = MeshBrep(
    Brep=splop,
    Settings={GridMaxCount=0, GridMinCount=16, JaggedSeams=False, MaxEdgeLength=0, MinEdgeLength=0.0001, MinTolerance=0, Refine=True, RefineAngle=0, RelativeTolerance=0.65, SimplePlanes=True, Tolerance=0})
twn2crvs = TweenTwoCurves(CurveA=flip.Curve, CurveB=crv_9, Factor=Slider(0.2, range=0..1), Refit=0, PointSample=0)

boundary_2 = BoundarySurfaces(Edges=crv_10)
mesh_2 = MeshBrep(
    Brep=boundary_2,
    Settings={GridMaxCount=0, GridMinCount=16, JaggedSeams=False, MaxEdgeLength=0, MinEdgeLength=0.0001, MinTolerance=0, Refine=True, RefineAngle=0, RelativeTolerance=0.65, SimplePlanes=True, Tolerance=0})
triremesh = TriRemesh(Geometry=mesh, Length=Slider(0.1, range=0..1), Iterations=Slider(20, range=0..100))  # -> Triangulation, Dual, Creases; disabled

nv = NakedVertices(Mesh=triremesh.Triangulation)  # -> ClothedIndex, NakedIndex, ClothedPts, NakedPts
meshedges = MeshEdges(Mesh=triremesh.Triangulation)  # -> flatten(AllE), NakedE
anchor = Anchor(Point=nv.NakedPts, Strength=Slider(116, range=0..10000))
length_line = LengthLine(Line=meshedges.AllE, Strength=Slider(0.04, range=0..4))
pressure = Pressure(M=triremesh.Triangulation, Strength=Slider(0.049, range=0..1))
show = Show(G=triremesh.Triangulation)
entwine = Entwine(Branch00=length_line, Branch01=anchor, Branch02=pressure, Branch03=show, FlattenInputs=True)
bouncysolver = BouncySolver(
    GoalObjects=entwine,
    Reset=Button(),
    Threshold=1e-15,
    Tolerance=0.0001,
    Damping=Slider(0.9, range=0..1),
    Iterations=Slider(27, range=0..100),
    On=Toggle(False))  # -> I, V, O
lng = ListLength(List=bouncysolver.O)
addition = Addition(A=lng, B=Slider(-1, range=-4..4))
cluster = Cluster(rhobj=bouncysolver.O)
item_3 = ListItem(List=bouncysolver.O, Index=addition, Wrap=True)

mesh_3 = Mesh(graft(cluster))

# ==== cluster Cluster
rhobj = ClusterInput()
sortbytype = SortObjectsByType(RhinoObjects=rhobj)  # -> Points, Curves, Surfaces, Breps, Meshes, TextObjects, HatchObjects, LightObjects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
mesh = ClusterOutput(sortbytype.Meshes)
